# Grasshopper definition parts.gh (Grasshopper 1.0.7)

division = Division(A=Slider(5, range=0..100), B="2")
division_2 = Division(A=Slider(5, range=0..100), B="2")
division_3 = Division(A=Slider(22, range=0..22), B="2")
addition = Addition(A="2", B=division)
addition_2 = Addition(A=Slider(2, range=0..100), B=division_2)
cir = Circle(Plane=PlaneXY(0, 0, 0), Radius=division)
cir_2 = Circle(Plane=PlaneXY(0, 0, 0), Radius=division_2)
addition_3 = Addition(A=Slider(8, range=0..10), B=division_3)
cir_3 = Circle(Plane=PlaneXY(0, 0, 0), Radius=addition)
cir_4 = Circle(Plane=PlaneXY(0, 0, 0), Radius=addition_2)
cyl = Cylinder(Base=PlaneXY(0, 0, 0), Radius=division_3, Length="10")
Z = UnitZ(Factor="10")
boundary = BoundarySurfaces(Edges=cir)
Z_2 = UnitZ(Factor="10")
boundary_2 = BoundarySurfaces(Edges=cir_2)
cyl_2 = Cylinder(Base=PlaneXY(0, 0, 0), Radius=addition_3, Length="10")
boundary_3 = BoundarySurfaces(Edges=cir_3)
boundary_4 = BoundarySurfaces(Edges=cir_4)
cap = CapHoles(Brep=cyl_2)
cap_2 = CapHoles(Brep=cyl)
extr = Extrude(Base=boundary, Direction=Z)
extr_2 = Extrude(Base=boundary_2, Direction=Z_2)
extr_3 = Extrude(Base=boundary_3, Direction=Z)
extr_4 = Extrude(Base=boundary_4, Direction=Z_2)
cap_3 = CapHoles(Brep=extr)
cap_4 = CapHoles(Brep=extr_2)
sdiff = SolidDifference(BrepsA=cap, BrepsB=cap_2)
cap_5 = CapHoles(Brep=extr_3)
cap_6 = CapHoles(Brep=extr_4)
sdiff_2 = SolidDifference(BrepsA=cap_5, BrepsB=cap_3)
sdiff_3 = SolidDifference(BrepsA=cap_6, BrepsB=cap_4)
